# Grasshopper definition GH Workspace 2.gh (Grasshopper 1.0.8)

processvars = Python3Script()  # -> report, outputFileAddress
# ---------- processvars: Python ----------
import sys
import os

# Execute transition based on Boolean toggle
if on_off:
    print("Executing transition...")

    # modulePath = r"U:\SHORTLIST\ICT Capstone Project\Capstone2-githubDuplicate"

    if modulePath not in sys.path:
        sys.path.append(modulePath)

    print(f"Accessing {modulePath} for transition.")

    # Opening gui to perform user-defined variable transfer
    # Below is the execution code as in the main.py file with some adjustment

    from gui import VariableTransferGUI

    print("Transferring HabSim parameters...")

    def main():
        app = VariableTransferGUI()
        app.mainloop()

        destinationPath = app.destination.get().strip()
        return destinationPath

    if __name__ == "__main__":
        outputFileAddress = main()

    print(f"HabSim parameters transferred to {outputFileAddress}")

else:
    print("Execution of transition paused.")
# ---------- end processvars ----------
path_to_gui_py_here = Panel("U:\SHORTLIST\ICT Capstone Project\Capstone2-githubDuplicate")
double_click_to_start = BooleanToggle(True)

# ---- group: Process HabSim outputs into GH
processvars_2 = Python3Script(modulePath=path_to_gui_py_here, on_off=double_click_to_start)  # -> report, outputFileAddress
# ---------- processvars_2: Python ----------
import sys
import os

# Execute transition based on Boolean toggle
if on_off:
    print("Executing transition...")

    # modulePath = r"U:\SHORTLIST\ICT Capstone Project\Capstone2-githubDuplicate"

    print(f"Accessing {modulePath} for transition.")

    if modulePath not in sys.path:
        sys.path.append(modulePath)

    # Opening gui to perform user-defined variable transfer
    # Below is the execution code as in the full_run_test.py file with some adjustment

    from variable_transfer_v2 import transfer_data
    from run_matlab_import_python_v2 import full_run

    input_file = os.path.join(modulePath, "python_variables.txt")
    output_file = os.path.join (modulePath, "matlab_variables.m")

    full_run(input_file, output_file, "json")

    outputFileAddress = output_file; 

    print(f"HabSim parameters transferred to {outputFileAddress}")

else:
    print("Execution of transition paused.")
# ---------- end processvars_2 ----------
panel = Panel(processvars_2.report)

# ---- group: Parse the transferred variables to update visual geometry (.m)
readtransferred = Python3Script(matlabLocation=processvars_2.outputFileAddress)  # -> report, parsedVar
# ---------- readtransferred: Python ----------
# MATLAB goes here!!

# Read in transferred variables
print("[Terminal output will appear here.]")

# Parse variables 
parsedVar = "[List of MATLAB outputs go here.]"
# ---------- end readtransferred ----------
currently_velocity_and_displacement_valu = Panel(readtransferred.parsedVar)  # "(Currently velocity and displacement values)"
panel_2 = Panel(readtransferred.report)

# ----
path_to_gh_output_file = Panel()

# ---- group: Generate HabSim inputs
writeoutput = Python3Script(outputFileAddress=path_to_gh_output_file, variables=currently_velocity_and_displacement_valu)  # -> report
# ---------- writeoutput: Python ----------
"""Grasshopper Script"""
a = "[Terminal output will appear here.]"
print(a)
# ---------- end writeoutput ----------
panel_3 = Panel(writeoutput)
