# Grasshopper definition GH Workspace.gh (Grasshopper 1.0.8)

path_to_gui_py_here = Panel("U:\SHORTLIST\ICT Capstone Project\Capstone2-githubDuplicate")
double_click_to_start = BooleanToggle(False)

# ---- group: Process HabSim outputs into GH
processvars = Python3Script(modulePath=path_to_gui_py_here, on_off=double_click_to_start)  # -> report, outputFileAddress
# ---------- processvars: Python ----------
# Execute transition based on Boolean toggle
if on_off:
    print("Executing transition...")

    # Lines 2 - 8 are added to read external functions/modules
    import sys
    import os

    # modulePath = r"U:\SHORTLIST\ICT Capstone Project\Capstone2-githubDuplicate"

    if modulePath not in sys.path:
        sys.path.append(modulePath)

    print(f"Accessing {modulePath} for transition.")

    # Opening gui to perform user-defined variable transfer
    # Below is the execution code as in the main.py file with some adjustment

    from gui import VariableTransferGUI

    print("Transferring HabSim parameters...")

    def main():
        app = VariableTransferGUI()
        app.mainloop()

        destinationPath = app.destination.get().strip()
        return destinationPath

    if __name__ == "__main__":
        outputFileAddress = main()

    print(f"HabSim parameters transferred to {outputFileAddress}")

else:
    print("Execution of transition paused.")
# ---------- end processvars ----------
panel = Panel(processvars.report)

# ---- group: Parse the transferred variables for simulation (.m)
# Translation of variables into visual geometry somewhere above
readtransferred = Python3Script(varLocation=processvars.outputFileAddress)  # -> report, parsedVar
# ---------- readtransferred: Python ----------
# MATLAB goes here!!

# Read in transferred variables
print("[Terminal output will appear here.]")

# Parse variables 
parsedVar = "[List of MATLAB outputs go here.]"
# ---------- end readtransferred ----------
currently_velocity_and_displacement_valu = Panel(readtransferred.parsedVar)  # "(Currently velocity and displacement values)"
panel_2 = Panel(readtransferred.report)

# ----
path_to_gh_output_file = Panel()

writeoutput = Python3Script(outputFileAddress=path_to_gh_output_file, variables=currently_velocity_and_displacement_valu)  # -> report
# ---------- writeoutput: Python ----------
"""Grasshopper Script"""
a = "[Terminal output will appear here.]"
print(a)
# ---------- end writeoutput ----------
panel_3 = Panel(writeoutput)
