# Grasshopper definition GH-HABSIM-Prototype3.gh (Grasshopper 1.0.8)

run_no = Panel("1")

# ----
# EXCEL SETTINGS
# C:\Users\aic718\OneDrive - University of Texas at San Antonio\Desktop\Hab-Rhino\GH-MATLAB-MS EG files\Test\HelloHab.xlsx
# Click False/True to Toggle Excel output
true_running_false_not_running = BooleanToggle(False)

r_theta_r_is_the_radial_location_and_the = ValueList({"Inside Dome - Very close to Power": "2,60", "Inside Dome - Very close to ECLSS": "2,210"}, selected="Inside Dome - Very close to Power")  # "[R,Theta] R is the Radial Location and Theta is Angle From the Origin of Fire Initiation Point [m,theta]"
celcius = Slider(25, range=18..27)
# Power
no_of_panels_that_get_nominal_dust_accum = Slider(0, range=0..50)  # "No. of panels that get nominal dust accumulation"
# Simulink Agent
max_energy_per_battery_cell_energy_kwh_d = Slider(0.15, range=0..1)  # "Max energy per battery cell energy [kWh] (Default = 0.15)"
the_number_of_damaged_components_initial = Slider(5, range=1..7)  # "The number of damaged components initially due to meteorite impact [1,7]"
the_number_of_damaged_components_initial_2 = Slider(3, range=1..7)  # "The number of damaged components initially due to moonquake [1,7]"
determine_the_time_that_fire_is_detected = Slider(150, range=0..1000)  # "Determine the time that fire is detected [s] (It should be more than 50 sec)"
# Launch Start Time Notes: Place launch.tStart after simulation to indicate no launch
dust_intensity_parameter_for_engine_exha = Slider(50, range=1..1000)  # "Dust intensity parameter for engine exhaust, unit: mg/cm^2/s-engine exhaust"
moonquake_duration_s_it_must_be_grater_t = Slider(20, range=0..1000)  # "Moonquake duration [s], It must be grater than 50 sec"
x_y_meteorite_impact_cartesian_coordinat = ValueList({"Exterior - Solar Array": "23.38,-38.92", "Exterior - Nuclear Panels": "-33.80,-63.57", "Exterior - ECLSS Radiator": "-22.26,35.62", "Dome/Interior - Above Power in Z1": "0.54,0.54", "Dome/Interior - Above Power in Z2": "-0.54,0.54", "Dome/Interior - Z1": "0.54,-0.54", "Dome/Interior - Z2": "-0.54,-0.54"}, selected="Dome/Interior - Z1")  # "[x,y] meteorite impact cartesian coordinates (m)"
sun_start_angle = ValueList({"0 degrees": 0, "45 degrees": 45, "90 degrees": 90, "135 degrees": 135, "179 degrees": 179}, selected="0 degrees")
meteorite_dustaccumrate_1_nuclear_radiat = Panel("0,0,0")  # "meteorite.dustAccumRate (1) Nuclear Radiators (2) Solar PV Arrays (3) ECLSS Radiators"
# EXTERIOR ENVIRONMENT SETTINGS
# Exterior Environment Component Notes for dust accumulation: (1) Nuclear Radiators
# (2) Solar PV Arrays
# (3) ECLSS Radiators
# 
# listed as 1, 2, 3 in the norminal_dust_accum_rate
norminal_dust_accum_rate_g_cm_2_s = Panel("0.0,0.0,0.0")
maint_sys5_fan_dust_accumulation_g_cm_2 = Slider(0, range=0..20)  # "Maint.Sys5.Fan Dust Accumulation [g/cm^2/s]"
# INITIAL CONDITIONS and CONTROL SETPOINTS
# ECLSS
sun_on_off = ValueList({"Sun On": 1, "Sun Off": 0}, selected="Sun On")
nuclear_power_scaling_factor_max_5_8kw = Slider(1, range=1..5.8)
the_number_of_damaged_components_initial_3 = Slider(3, range=1..5)  # "The number of damaged components initially due to fire [1,5]"
# GENERAL SIMULATION PARAMETERS
panel = Panel("T_End")
duration_of_dust_accumulation_due_to_lau = Slider(10, range=1..1000)  # "Duration of dust accumulation due to launch/landing event [s]"
for_il_5_up_to_5_converters_can_be_damag = Panel("2 1 1 1 1")  # "For IL = 5, up to 5 converters can be damage"
for_il_4_up_to_3_converters_can_be_damag = Panel("2 2 3")  # "For IL = 4, up to 3 converters can be damage"
start_of_dust_accumulation_due_to_launch = Slider(999999, range=1..999999)  # "Start of dust accumulation due to launch/landing event [s]"
remaining_energy_storage_after_moonquake = Slider(0.89, range=0..1)  # "Remaining energy storage after moonquake affects ES"
default_only_1_2_3_4_5_6_7_can_be_damage = Panel("1, 2, 3, 4, 5, 6, 7")  # "Default: Only 1, 2, 3, 4, 5, 6, 7 can be damaged"
# ECLSS System Notes: % 1. Air Tank leak,
# % 2. Pressure Supply Valve Malfunction/stuck
# % 3. Condenser Coil Deformation
# % 4. Compressor Degradation
# % 5. Evaporator Coil Deformation
# % 6. Heater Degradation
# % 7. ATCS Fan Degradation
default_only_3_4_5_6_7_can_be_damaged = Panel("3, 4, 5, 6, 7")
default_only_1_2_3_4_5_6_7_can_be_damage_2 = Panel("1, 2, 3, 4, 5, 6, 7")  # "Default: Only 1, 2, 3, 4, 5, 6, 7 can be damaged"
remaining_energy_storage_in_case_of_mete = Panel("0.3")  # "Remaining energy storage in case of meteorite impact IL = 4"
remaining_energy_storage_in_case_of_mete_2 = Panel("0.1")  # "Remaining energy storage in case of meteorite impact IL = 5"
kelvin_k = Addition(A=celcius, B="273.15")
number_of_battery_cells_piece_default_10 = Panel("1000")  # "Number of battery cells [piece] (Default = 1000)"
specify_path_to_the_settings_csv_for_dia = Panel("\"Diagnostic_Test_Settings_User.csv\"")  # "Specify PATH to the settings CSV for Diagnostic Tests"
specify_path_to_the_settings_csv_for_hms = Panel("\"HMS_Agent_Settings_User.csv\"")  # "Specify PATH to the settings CSV for HMS and Agents"
initial_dust_cover_ratio = Slider(0, range=0..1)
t_end = Slider(26350, range=0..100000)
energy_storage_left_when_fire_il_4_occur = Slider(0.3, range=0..1)  # "Energy storage left when fire IL 4 occurs"
energy_storage_left_when_fire_il_5_occur = Slider(0.1, range=0..1)  # "Energy storage left when fire IL 5 occurs"
print_interval = Slider(0, range=0..10)
coolant_nuclear_fault_detection_time_s = Slider(4, range=0..1000)
array_power_generation_capacity_kw = Panel("5.7")
max_fire_spread_rate_0_0070_m_s = Slider(0.001, range=0.001..0.007)
list = ValueList({"Distances all the same constant (m)": 1, "Distances not including traveling to the inventory (m)": 2, "Distances including traveling to the inventory (m)": 3}, selected="Distances including traveling to the inventory (m)")
meteorite_holeradius_il4_m = Slider(0.05, range=0..0.15)
meteorite_holeradius_il5_m = Slider(0.15, range=0..0.15)
eclss_radiatorloop_discretenumber = Panel("50")
length_of_one_radiator_m = Panel("0.01")
meteorite_dustduration_s = Slider(30, range=1..60)
meteorite_impactstart_s = Slider(1, range=1..1000)
target_point_heating = Panel("1")
target_point_cooling = Panel("1")
airlock_fault_detection_time_s = Slider(10, range=0..1000)
ic_sys8_initial_pressure = Panel("101325")
sim_agent_travel_speed_m_s = Slider(5, range=0..100)
coolant_nuclear_start_time_s = Slider(2, range=0..1000)
meteorite_impact_intensity_level = ValueList({"One": 1, "Two": 2, "Three": 3, "Four": 4, "Five": 5}, selected="One")
fire_start_time_s = Slider(50, range=0..1000)
moonquake_start_time_s = Slider(5, range=0..1000)
coolant_nuclear_failure_intensity_level = ValueList({"One": 1, "Two": 2, "Three": 3, "Four": 4, "Five": 5}, selected="One")
moonquake_impact_intensity_level = ValueList({"One": 1, "Two": 2, "Three": 3, "Four": 4, "Five": 5}, selected="One")
sim_agent_ititial_prep_s = Slider(3, range=0..1000)
merge = Merge(Data1="Run No.", Data2=panel, Data3="print_interval")
merge_2 = Merge(
    Data1="Run No.",
    Data2="ECLSS_radiatorLoop_discreteNumber",
    Data3="ECLSS_radiatorLoop_LengthPerPanel",
    Data4="N_natural_dust")
merge_3 = Merge(Data1="Run No.", Data2="norminal_dust_accum_rate", Data3="Maint.Sys5.Fan", Data4="Sun.Start_angle", Data5="Sun.ON_OFF")
airlock_start_time_s = Slider(2, range=0..1000)
merge_4 = Merge(Data1="Run No.", Data2="solar_PV_capacity", Data3="solar_DRatio_ini", Data4="nuclear_power_multiplier")
merge_5 = Merge(Data1="Run No.", Data2="ES_number_of_cells", Data3="cell_energy", Data4="energy_stored_initial")
airlock_failure_intensity_level = ValueList({"One": 1, "Two": 2, "Three": 3, "Four": 4, "Five": 5}, selected="One")
merge_6 = Merge(
    Data1="Run No.",
    Data2="IC.Sys8.Initial_temperature",
    Data3="IC.Sys8.Initial_pressure",
    Data4="Target_Point_cooling",
    Data5="Target_Point_heating")
fire_impact_intensity_level = ValueList({"One": 1, "Two": 2, "Three": 3, "Four": 4, "Five": 5}, selected="One")
merge_7 = Merge(Data1="Run No.", Data2="SD_Toggle.PW", Data3="SD.Sys3.Cov_3", Data4="SD.Sys3.Cov_5")
merge_8 = Merge(Data1="Run No.", Data2="Sim_Agent.Ititial_Prep", Data3="Sim_Agent.Travel_Speed", Data4="Sim_Agent.Distance_Type")
merge_9 = Merge(Data1="Run No.", Data2="Sys6U.agent_operational_mode", Data3="Sys6U.settings_csv", Data4="Sys6U.test_settings_file")
merge_10 = Merge(Data1="Run No.", Data2="N_dmg_fire", Data3="N_dmg_mi", Data4="N_dmg_mq")
merge_11 = Merge(Data1="Run No.", Data2="SD_Toggle.ECLSS", Data3="SD.Sys5.Dmg_fire", Data4="SD.Sys5.Dmg_mi", Data5="SD.Sys5.Dmg_mq")
merge_12 = Merge(Data1="Run No.", Data2="meteorite.IL", Data3="meteorite.impactStart", Data4="meteorite.coordinates")
panel_2 = Panel(merge_2)
short = ShortestList(ListA=run_no, ListB=t_end, ListD=print_interval, TrimMode=2)  # -> ListA, ListB, ListD
panel_3 = Panel(merge_4)
merge_13 = Merge(Data1="Run No.", Data2="fire.IL", Data3="fire.tStart", Data4="fire.tDetection", Data5="fire.polar_coordinates")
merge_14 = Merge(
    Data1="Run No.",
    Data2="meteorite.holeRadius_IL4",
    Data3="meteorite.holeRadius_IL5",
    Data4="meteorite.dustDuration",
    Data5="meteorite.dustAccumRate")
panel_4 = Panel(merge_5)
merge_15 = Merge(Data1="Run No.", Data2="SD.Sys3.ES_damage_Fire_IL_4", Data3="SD.Sys3.ES_damage_Fire_IL_5", Data4="fireSpreadRate")
panel_5 = Panel(merge)
merge_16 = Merge(
    Data1="Run No.",
    Data2="moonquake.IL",
    Data3="moonquake.tStart",
    Data4="moonquake.Duration",
    Data5="SD.Sys3.ES_damage_Moonquake_IL_5")
list_2 = ValueList({"Deterministic": 1, "Stochastic": 2}, selected="Deterministic")
panel_6 = Panel(merge_6)
merge_17 = Merge(Data1="Run No.", Data2="airlock.IL", Data3="airlock.tStart", Data4="airlock.tDetection")
panel_7 = Panel(merge_3)
merge_18 = Merge(Data1="Run No.", Data2="CoolantNuclear.IL", Data3="CoolantNuclear.tStart", Data4="CoolantNuclear.tDetection")
merge_19 = Merge(Data1="Run No.", Data2="launch.tStart", Data3="launch.Duration", Data4="launch.Exhaust_Intensity")
list_3 = ValueList({"Deterministic": 1, "Stochastic": 2}, selected="Deterministic")
merge_20 = Merge(Data1="Run No.", Data2="SD.Sys3.ES_damage_Meteorite_IL_4", Data3="SD.Sys3.ES_damage_Meteorite_IL_5")
short_2 = ShortestList(
    ListA=run_no,
    ListC=norminal_dust_accum_rate_g_cm_2_s,
    ListD=maint_sys5_fan_dust_accumulation_g_cm_2,
    ListE=sun_start_angle,
    ListB=sun_on_off,
    TrimMode=2)  # -> ListA, ListC, ListD, ListE, ListB
short_3 = ShortestList(
    ListA=run_no,
    ListB=eclss_radiatorloop_discretenumber,
    ListC=length_of_one_radiator_m,
    ListD=no_of_panels_that_get_nominal_dust_accum,
    TrimMode=2)  # -> ListA, ListB, ListC, ListD, ListE
short_4 = ShortestList(
    ListA=run_no,
    ListB=array_power_generation_capacity_kw,
    ListC=initial_dust_cover_ratio,
    ListD=nuclear_power_scaling_factor_max_5_8kw,
    TrimMode=2)  # -> ListA, ListB, ListC, ListD, ListE
short_5 = ShortestList(ListA=run_no, ListB=number_of_battery_cells_piece_default_10, ListC=max_energy_per_battery_cell_energy_kwh_d, TrimMode=2)  # -> ListA, ListB, ListC, ListD, ListE
short_6 = ShortestList(
    ListA=run_no,
    ListB=kelvin_k,
    ListC=ic_sys8_initial_pressure,
    ListD=target_point_cooling,
    ListE=target_point_heating,
    TrimMode=2)  # -> ListA, ListB, ListC, ListD, ListE
panel_8 = Panel(merge_12)
panel_9 = Panel(merge_8)
panel_10 = Panel(merge_7)
panel_11 = Panel(merge_9)
panel_12 = Panel(merge_11)
panel_13 = Panel(merge_10)
panel_14 = Panel(merge_13)
entwine = Entwine(Branch0X=short.ListA, Branch1X=short.ListB, Branch2X=short.ListD, FlattenInputs=False)  # -> simplify(Result)
panel_15 = Panel(merge_15)
panel_16 = Panel(merge_16)
panel_17 = Panel(merge_14)
panel_18 = Panel(merge_17)
short_7 = ShortestList(
    ListA=run_no,
    ListB=meteorite_holeradius_il4_m,
    ListC=meteorite_holeradius_il5_m,
    ListD=meteorite_dustduration_s,
    ListE=meteorite_dustaccumrate_1_nuclear_radiat,
    TrimMode=2)  # -> ListA, ListB, ListC, ListD, ListE
panel_19 = Panel(merge_18)
panel_20 = Panel(merge_19)
short_8 = ShortestList(
    ListA=run_no,
    ListB=meteorite_impact_intensity_level,
    ListC=meteorite_impactstart_s,
    ListD=x_y_meteorite_impact_cartesian_coordinat,
    TrimMode=2)  # -> ListA, ListB, ListC, ListD
panel_21 = Panel(merge_20)
short_9 = ShortestList(
    ListA=run_no,
    ListE=remaining_energy_storage_in_case_of_mete,
    ListF=remaining_energy_storage_in_case_of_mete_2,
    TrimMode=2)  # -> ListA, ListE, ListF
short_10 = ShortestList(
    ListA=run_no,
    ListP=list_2,
    ListQ=for_il_4_up_to_3_converters_can_be_damag,
    ListR=for_il_5_up_to_5_converters_can_be_damag,
    TrimMode=2)  # -> ListA, ListP, ListQ, ListR, ListS
entwine_2 = Entwine(Branch0X=short_3.ListA, Branch1X=short_3.ListB, Branch2X=short_3.ListC, Branch3X=short_3.ListD, FlattenInputs=False)  # -> simplify(Result)
short_11 = ShortestList(
    ListA=run_no,
    ListP="1",
    ListQ=specify_path_to_the_settings_csv_for_hms,
    ListR=specify_path_to_the_settings_csv_for_dia,
    TrimMode=2)  # -> ListA, ListP, ListQ, ListR, ListS
short_12 = ShortestList(
    ListA=run_no,
    ListB=fire_impact_intensity_level,
    ListC=fire_start_time_s,
    ListD=determine_the_time_that_fire_is_detected,
    ListE=r_theta_r_is_the_radial_location_and_the,
    TrimMode=2)  # -> ListA, ListB, ListC, ListD, ListE
entwine_3 = Entwine(Branch0X=short_4.ListA, Branch1X=short_4.ListB, Branch2X=short_4.ListC, Branch3X=short_4.ListD, FlattenInputs=False)  # -> simplify(Result)
short_13 = ShortestList(
    ListA=run_no,
    ListB=energy_storage_left_when_fire_il_4_occur,
    ListC=energy_storage_left_when_fire_il_5_occur,
    ListD=max_fire_spread_rate_0_0070_m_s,
    TrimMode=2)  # -> ListA, ListB, ListC, ListD, ListE
short_14 = ShortestList(
    ListA=run_no,
    ListB=moonquake_impact_intensity_level,
    ListC=moonquake_start_time_s,
    ListD=moonquake_duration_s_it_must_be_grater_t,
    ListE=remaining_energy_storage_after_moonquake,
    TrimMode=2)  # -> ListA, ListB, ListC, ListD, ListE
entwine_4 = Entwine(Branch0X=short_5.ListA, Branch1X=short_5.ListB, Branch2X=short_5.ListC, FlattenInputs=False)  # -> simplify(Result)
short_15 = ShortestList(
    ListA=run_no,
    ListP=list_3,
    ListQ=default_only_3_4_5_6_7_can_be_damaged,
    ListR=default_only_1_2_3_4_5_6_7_can_be_damage,
    ListS=default_only_1_2_3_4_5_6_7_can_be_damage_2,
    TrimMode=2)  # -> ListA, ListP, ListQ, ListR, ListS
short_16 = ShortestList(
    ListA=run_no,
    ListQ=the_number_of_damaged_components_initial_3,
    ListR=the_number_of_damaged_components_initial,
    ListS=the_number_of_damaged_components_initial_2,
    TrimMode=2)  # -> ListA, ListQ, ListR, ListS
entwine_5 = Entwine(
    Branch0X=short_2.ListA,
    Branch1X=short_2.ListC,
    Branch2X=short_2.ListD,
    Branch3X=short_2.ListE,
    Branch4X=short_2.ListB,
    FlattenInputs=False)  # -> simplify(Result)
short_17 = ShortestList(
    ListA=run_no,
    ListB=airlock_failure_intensity_level,
    ListC=airlock_start_time_s,
    ListD=airlock_fault_detection_time_s,
    TrimMode=2)  # -> ListA, ListB, ListC, ListD, ListE
short_18 = ShortestList(ListA=run_no, ListB=sim_agent_ititial_prep_s, ListC=sim_agent_travel_speed_m_s, ListD=list, TrimMode=2)  # -> ListA, ListB, ListC, ListD
entwine_6 = Entwine(
    Branch0X=short_6.ListA,
    Branch1X=short_6.ListB,
    Branch2X=short_6.ListC,
    Branch3X=short_6.ListD,
    Branch4X=short_6.ListE,
    FlattenInputs=False)  # -> simplify(Result)
short_19 = ShortestList(
    ListA=run_no,
    ListB=coolant_nuclear_failure_intensity_level,
    ListC=coolant_nuclear_start_time_s,
    ListD=coolant_nuclear_fault_detection_time_s,
    TrimMode=2)  # -> ListA, ListB, ListC, ListD, ListE
short_20 = ShortestList(
    ListA=run_no,
    ListB=start_of_dust_accumulation_due_to_launch,
    ListC=duration_of_dust_accumulation_due_to_lau,
    ListD=dust_intensity_parameter_for_engine_exha,
    TrimMode=2)  # -> ListA, ListB, ListC, ListD, ListE
entwine_7 = Entwine(Branch0X=short_8.ListA, Branch1X=short_8.ListB, Branch2X=short_8.ListC, Branch3X=short_8.ListD, FlattenInputs=False)  # -> simplify(Result)
entwine_8 = Entwine(
    Branch0X=short_7.ListA,
    Branch1X=short_7.ListB,
    Branch2X=short_7.ListC,
    Branch3X=short_7.ListD,
    Branch4X=short_7.ListE,
    FlattenInputs=False)  # -> simplify(Result)
entwine_9 = Entwine(Branch0X=short_9.ListA, Branch1X=short_9.ListE, Branch2X=short_9.ListF, FlattenInputs=False)  # -> simplify(Result)
entwine_10 = Entwine(
    Branch0X=short_12.ListA,
    Branch1X=short_12.ListB,
    Branch2X=short_12.ListC,
    Branch3X=short_12.ListD,
    Branch4X=short_12.ListE,
    FlattenInputs=False)  # -> simplify(Result)
entwine_11 = Entwine(Branch0X=short_10.ListA, Branch1X=short_10.ListP, Branch2X=short_10.ListQ, Branch3X=short_10.ListR, FlattenInputs=False)  # -> simplify(Result)
entwine_12 = Entwine(Branch0X=short_13.ListA, Branch1X=short_13.ListB, Branch2X=short_13.ListC, Branch3X=short_13.ListD, FlattenInputs=False)  # -> simplify(Result)
entwine_13 = Entwine(
    Branch0X=short_14.ListA,
    Branch1X=short_14.ListB,
    Branch2X=short_14.ListC,
    Branch3X=short_14.ListD,
    Branch4X=short_14.ListE,
    FlattenInputs=False)  # -> simplify(Result)
entwine_14 = Entwine(Branch0X=short_11.ListA, Branch1X=short_11.ListP, Branch2X=short_11.ListQ, Branch3X=short_11.ListR, FlattenInputs=False)  # -> simplify(Result)
entwine_15 = Entwine(Branch0X=short_16.ListA, Branch1X=short_16.ListQ, Branch2X=short_16.ListR, Branch3X=short_16.ListS, FlattenInputs=False)  # -> simplify(Result)
entwine_16 = Entwine(Branch0X=short_17.ListA, Branch1X=short_17.ListB, Branch2X=short_17.ListC, Branch3X=short_17.ListD, FlattenInputs=False)  # -> simplify(Result)
entwine_17 = Entwine(Branch0X=short_18.ListA, Branch1X=short_18.ListB, Branch2X=short_18.ListC, Branch3X=short_18.ListD, FlattenInputs=False)  # -> simplify(Result)
entwine_18 = Entwine(
    Branch0X=short_15.ListA,
    Branch1X=short_15.ListP,
    Branch2X=short_15.ListQ,
    Branch3X=short_15.ListR,
    Branch4X=short_15.ListS,
    FlattenInputs=False)  # -> simplify(Result)
entwine_19 = Entwine(Branch0X=short_19.ListA, Branch1X=short_19.ListB, Branch2X=short_19.ListC, Branch3X=short_19.ListD, FlattenInputs=False)  # -> simplify(Result)
entwine_20 = Entwine(Branch0X=short_20.ListA, Branch1X=short_20.ListB, Branch2X=short_20.ListC, Branch3X=short_20.ListD, FlattenInputs=False)  # -> simplify(Result)
panel_22 = Panel(entwine_2)
panel_23 = Panel(entwine_5)
panel_24 = Panel(entwine_3)
panel_25 = Panel(entwine_4)
panel_26 = Panel(entwine_6)
panel_27 = Panel(entwine_7)
panel_28 = Panel(entwine_8)
panel_29 = Panel(entwine_9)
panel_30 = Panel(entwine_10)
panel_31 = Panel(entwine_17)
panel_32 = Panel(entwine_12)
panel_33 = Panel(entwine_11)
panel_34 = Panel(entwine_13)
panel_35 = Panel(entwine_14)
panel_36 = Panel(entwine_16)
panel_37 = Panel(entwine)
panel_38 = Panel(entwine_18)
panel_39 = Panel(entwine_15)
panel_40 = Panel(entwine_19)
panel_41 = Panel(entwine_20)
merge_21 = Merge(Data1=short.ListA, Data2=short.ListB, Data3=short.ListD)
panel_42 = Panel(merge_21)
# Agent - Decision Making Settings
panel_43 = Panel("Sys6U.agent_operational_mode")
meteorite_dustaccumrate_1_nuclear_radiat_2 = Panel("0 ! 10 ! 10")  # "meteorite.dustAccumRate (1) Nuclear Radiators (2) Solar PV Arrays (3) ECLSS Radiators"
x_y_meteorite_impact_cartesian_coordinat_2 = ValueList({"Exterior - Solar Array": "23.38,-38.92", "Exterior - Nuclear Panels": "-33.80,-63.57", "Exterior - ECLSS Radiator": "-22.26,35.62", "Dome/Interior - Above Power in Z1": "0.54,0.54", "Dome/Interior - Above Power in Z2": "-0.54,0.54", "Dome/Interior - Z1": "0.54,-0.54", "Dome/Interior - Z2": "-0.54,-0.54"}, selected="Dome/Interior - Z1")  # "[x,y] meteorite impact cartesian coordinates (m)"
specify_path_to_the_settings_csv_for_dia_2 = Panel("\"Diagnostic_Test_Settings_User.csv\"")  # "Specify PATH to the settings CSV for Diagnostic Tests"
specify_path_to_the_settings_csv_for_hms_2 = Panel("\"HMS_Agent_Settings_User.csv\"")  # "Specify PATH to the settings CSV for HMS and Agents"
meteorite_holeradius_il5_m_2 = Slider(0.04, range=0..0.15)
meteorite_holeradius_il4_m_2 = Slider(0.02, range=0..0.15)
meteorite_dustduration_s_2 = Slider(15, range=1..60)
meteorite_impactstart_s_2 = Slider(438, range=1..1000)
meteorite_impact_intensity_level_2 = ValueList({"One": 1, "Two": 2, "Three": 3, "Four": 4, "Five": 5}, selected="Two")
merge_22 = Merge(
    Data1=meteorite_impact_intensity_level_2,
    Data2=meteorite_impactstart_s_2,
    Data3=x_y_meteorite_impact_cartesian_coordinat_2,
    Data4=meteorite_holeradius_il4_m_2,
    Data5=meteorite_holeradius_il5_m_2,
    Data6=meteorite_dustduration_s_2,
    Data7=meteorite_dustaccumrate_1_nuclear_radiat_2,
    Data8="1",
    Data9=specify_path_to_the_settings_csv_for_hms_2,
    Data10=specify_path_to_the_settings_csv_for_dia_2)
matlab_file_path = Panel("U:\Capstone\grasshopper_integration\grasshopper_integration\matlab_test.m")
pythonexe_path = Panel("C:\Program Files\Maptek\Vulcan 2025.3\bin\exe\python.exe")
# Tarush Paths
repo_path = Panel("U:\Capstone\grasshopper_integration\grasshopper_integration")
# Repo Path: C:\Users\aic718\OneDrive - University of Texas at San Antonio\Desktop\Hab-Rhino\GH-HABSIM-Prototype\Prototype20261019\grasshopper_integration
# MatLab File Path: C:\Users\aic718\OneDrive - University of Texas at San Antonio\Desktop\HabSim\Monika MCVT v6.3 - 096\MCVT_v6_3_Input_File.m
# RunScenarios Path: C:\Users\aic718\OneDrive - University of Texas at San Antonio\Desktop\HabSim\Monika MCVT v6.3 - 096\MCVT_v6_3_RunScenarios.m
pythonexe_path_2 = Panel("C:\Users\aic718\AppData\Local\Programs\Python\Python314\python.exe")
merge_23 = Merge(
    Data1="meteorite.IL",
    Data2="meteorite.impactStart",
    Data3="meteorite.coordinates",
    Data4="meteorite.holeRadius_IL4",
    Data5="meteorite.holeRadius_IL5",
    Data6="meteorite.dustDuration",
    Data7="meteorite.dustAccumRate",
    Data8=panel_43,
    Data9="Sys6U.settings_csv",
    Data10="Sys6U.test_settings_file")
panel_44 = Panel(merge_23)
# Monika Paths
runscript_path = Panel("U:\Capstone\grasshopper_integration\grasshopper_integration\run_matlab.py")
panel_45 = Panel(merge_22)
block_1_gui_config = Python3Script(Repo=repo_path, Names=panel_44, Values=panel_45, MatlabFile=matlab_file_path, PythonExe=pythonexe_path, Open=Button())  # -> Config, Status; inputs Repo: String, Names: list of String, Values: list, MatlabFile: String, PythonExe: String, Open: Boolean
# ---------- block_1_gui_config: Python ----------
#! python 3
"""BLOCK 1 - GUI (opens the full Variable Transfer window)
Rhino 8 > Script editor > new "Python 3 Script" component.

The window is the same one as the standalone app, except:
  source      = the Names/Values wired into this block (live Grasshopper variables)
  destination = the MatlabFile wired into this block
Everything you set in it (mode, tick boxes, links, renames) is saved, and the
Transfer block uses it when you wire this block's Config output into it.

INPUTS  (right-click each input -> set Type Hint / Access as shown)
  Repo        str   item  - path to your Capstone2 folder
  Names       str   list  - GH variable names   (e.g. from a Panel)
  Values      (no type hint) TREE - one BRANCH per variable, in the same order
                            as Names. Numbers, text, true/false and points are all
                            fine. 1 item in a branch = one value, several items =
                            a vector/list (e.g. a time series). Set Tree Access
                            and leave the type hint EMPTY (a 'float' hint would
                            reject text). Your own formats (e.g. 1 | 2 | 3 ->
                            [1 2 3]) are set up in the GUI: Value Formats...
  MatlabFile  str   item  - the MATLAB .m file to transfer into
  PythonExe   str   item  - OPTIONAL, python with tkinter (default: "python")
  Open        bool  item  - wire a Button here; press to open the GUI

OUTPUTS
  Config      str   - path of the saved settings (wire to Transfer block)
  Status      str
"""
import sys
import Grasshopper as gh

Config, Status = None, ""
try:
    if Repo and Repo not in sys.path:
        sys.path.insert(0, str(Repo))
    import importlib, gh_bridge
    importlib.reload(gh_bridge)          # pick up edits without restarting Rhino

    Config = gh_bridge.DEFAULT_CONFIG_PATH
    if Open:
        gh_bridge.launch_config_gui(Names, Values, str(MatlabFile),
                                    str(PythonExe) if PythonExe else "python",
                                    Config)
        Status = "GUI opened. Click Save Configuration in it; Transfer block uses the result."
        gh_bridge.save_last_status(Status)
    else:
        have = gh_bridge.load_config(Config)
        Status = "Saved config found." if have else "No config yet - press Open."
        last = gh_bridge.load_last_status()   # a Button resets right after a press
        if last:
            Status += "  |  Last Open: " + last
except Exception as e:
    Config = None
    Status = "ERROR: %s" % e
    try:
        gh_bridge.save_last_status(Status)
    except Exception:
        pass
    ghenv.Component.AddRuntimeMessage(
        gh.Kernel.GH_RuntimeMessageLevel.Error, Status)
# ---------- end block_1_gui_config ----------
block_2_transfer_variables = Python3Script(
    Repo=repo_path,
    Names=panel_44,
    Values=panel_45,
    MatlabFile=matlab_file_path,
    Config=block_1_gui_config.Config,
    Run=Button())  # -> MatlabFile_Out, Report, Status; inputs Repo: String, Names: list of String, Values: list, MatlabFile: String, Config: String, Run: Boolean
# ---------- block_2_transfer_variables: Python ----------
#! python 3
"""BLOCK 2 - TRANSFER VARIABLES
Writes the Grasshopper values into the MATLAB .m file.

INPUTS
  Repo        str   item  - path to your Capstone2 folder
  Names       str   list  - GH variable names
  Values      (no type hint) TREE - one BRANCH per variable, in the same order
                            as Names. Numbers, text, true/false and points are all
                            fine. 1 item in a branch = one value, several items =
                            a vector/list (e.g. a time series). Set Tree Access
                            and leave the type hint EMPTY (a 'float' hint would
                            reject text). Your own formats (e.g. 1 | 2 | 3 ->
                            [1 2 3]) are set up in the GUI: Value Formats...
  MatlabFile  str   item  - the MATLAB .m file to write into
  Config      str   item  - OPTIONAL, from the GUI block. Uses the mode, selection,
                            links and renames you saved in the GUI window.
                            If empty, variables with the SAME NAME as one in the
                            .m file are overwritten.
  Run         bool  item  - Button / Toggle. Transfer happens when True.

OUTPUTS
  MatlabFile_Out  str  - same path, but ONLY after a successful transfer
                         (wire this to the Run MATLAB block so it waits)
  Report          str list - what changed (also logged to the GUI's History)
  Status          str
"""
import sys
import Grasshopper as gh

MatlabFile_Out, Report, Status = None, [], "Idle. Set Run = True."
try:
    if Run:
        if Repo and Repo not in sys.path:
            sys.path.insert(0, str(Repo))
        import importlib, gh_bridge
        importlib.reload(gh_bridge)

        Report, skipped = gh_bridge.transfer(Names, Values, str(MatlabFile),
                                             str(Config) if Config else None)
        MatlabFile_Out = str(MatlabFile)
        Status = "Transfer complete."
        if skipped:
            Status += " Skipped: " + "; ".join(skipped)
except Exception as e:
    MatlabFile_Out = None
    Status = "ERROR: %s" % e
    ghenv.Component.AddRuntimeMessage(
        gh.Kernel.GH_RuntimeMessageLevel.Error, Status)
# ---------- end block_2_transfer_variables ----------
# RunScript Path: C:\Users\aic718\OneDrive - University of Texas at San Antonio\Desktop\Hab-Rhino\GH-HABSIM-Prototype\Prototype20261019\grasshopper_integration\run_matlab.py
panel_46 = Panel("json")
panel_47 = Panel(block_1_gui_config.Status)
rec = DataRecorder(block_2_transfer_variables.Report, DataLimit=-10, RecordData=True)
panel_48 = Panel(block_2_transfer_variables.Status)
panel_49 = Panel(rec)
block_3_run_matlab = Python3Script(
    Repo=repo_path,
    RunScript=runscript_path,
    MatlabFile=matlab_file_path,
    SaveType=panel_46,
    PythonExe=pythonexe_path,
    Run=Button())  # -> OutputFile, Ready, Status
# ---------- block_3_run_matlab: Python ----------
#! python 3
"""BLOCK 3 - RUN MATLAB  (opens YOUR run_matlab.py)
Takes the three settings from this block's inputs, writes them into the top of
your run_matlab.py (CAPSTONE_FOLDER, MATLAB_FILE, SAVE_TYPE - nothing else in
the file is changed), then opens that script in its own window.
Grasshopper stays usable while it runs.

INPUTS
  Repo            str   item  - path to your Capstone2 folder (where gh_bridge.py is)
  RunScript       str   item  - full path to your run_matlab.py
  CapstoneFolder  str   item  - OPTIONAL. Folder that contains
                                run_matlab_import_python_v2.py. Empty = the Repo folder.
  MatlabFile      str   item  - the .m file (wire from Transfer block's MatlabFile_Out)
  SaveType        str   item  - "json", "csv" or "txt". Empty = "json".
  PythonExe       str   item  - OPTIONAL. Full path to a Python 3.10+ python.exe.
                                Empty = "python".
  Run             bool  item  - Button / Toggle. A run starts when this turns True.

OUTPUTS
  OutputFile  str   - path of matlab_output_variables.<SaveType>, once MATLAB has written it
  Ready       bool  - True once the output file has been written by this run
  Status      str

The script's window stays open until you press ENTER in it (your script ends
with input(...)). The results are ready BEFORE that - Ready turns True as soon
as MATLAB has written the file.
"""
import sys
import System
import Rhino
import Grasshopper as gh
import scriptcontext as sc

comp = ghenv.Component
key = "CapstoneRunScript_" + str(comp.InstanceGuid)

OutputFile, Ready, Status = None, False, "Idle. Press Run."
note = ""


def _recompute():
    """Called from a background thread when the output appears / the script exits."""
    def on_ui_thread():
        comp.ExpireSolution(True)
    try:
        Rhino.RhinoApp.InvokeOnUiThread(System.Action(on_ui_thread))
    except Exception:
        pass  # worst case: press F5 to refresh


try:
    if Repo and Repo not in sys.path:
        sys.path.insert(0, str(Repo))
    import importlib, gh_bridge
    importlib.reload(gh_bridge)

    run = sc.sticky.get(key)

    # Start a run only when Run turns True (a Toggle left on won't loop forever).
    was_on = sc.sticky.get(key + "_run", False)
    sc.sticky[key + "_run"] = bool(Run)
    if Run and not was_on:
        if run is not None and run.running:
            note = "Already running (see its window); close it or press ENTER there first. "
        else:
            if not RunScript:
                raise ValueError("RunScript is empty - give the full path to run_matlab.py.")
            if not MatlabFile:
                raise ValueError("MatlabFile is empty - has the Transfer block finished?")
            capstone = str(CapstoneFolder) if CapstoneFolder else str(Repo)
            changed = gh_bridge.update_script_settings(
                str(RunScript), capstone, str(MatlabFile), str(SaveType) if SaveType else "json")
            run = gh_bridge.ScriptRun(
                str(RunScript), str(PythonExe) if PythonExe else "python",
                str(MatlabFile), str(SaveType) if SaveType else "json",
                on_change=_recompute)
            sc.sticky[key] = run

    if run is not None:
        Ready = run.output_ready
        OutputFile = run.output_file if Ready else None
        if run.running and Ready:
            Status = "MATLAB finished - output is ready. Press ENTER in the script's window to close it."
        elif run.running:
            Status = "Running run_matlab.py (%d s so far)... a window has opened." % run.elapsed
        elif run.returncode == 0:
            Status = "Finished. Output: %s" % run.output_file
        else:
            Status = ("The script stopped with exit code %s and no output was written. "
                      "The error was shown in its window; run run_matlab.py yourself "
                      "(VS Code or Command Prompt) to see it again." % run.returncode)
            if Ready:
                Status = "The script exited with code %s, but the output file was written." % run.returncode
    Status = note + Status
except Exception as e:
    OutputFile, Ready = None, False
    Status = "ERROR: %s" % e
    ghenv.Component.AddRuntimeMessage(
        gh.Kernel.GH_RuntimeMessageLevel.Error, Status)
# ---------- end block_3_run_matlab ----------
rec_2 = DataRecorder(block_3_run_matlab.Status, DataLimit=-10, RecordData=True)
panel_50 = Panel(block_3_run_matlab.Status)
panel_51 = Panel(rec_2)
panel_52 = Panel(block_3_run_matlab.OutputFile)
panel_53 = Panel(block_3_run_matlab.Ready)
